# Grasshopper definition a2_Alexa.gh (Grasshopper 1.0.7)

circle_radius = Number(0.5)
number = Number(1)
subtraction = Subtraction(A=number, B=circle_radius)
circle = Circle(Plane=PlaneXY(0, 0, 0), Radius=circle_radius)
vector_xyz = VectorXYZ(XComponent=0, YComponent=subtraction, ZComponent=0)  # -> Vector, Length
move = Move(Geometry=circle, Motion=vector_xyz.Vector)  # -> Geometry, Transform
polar_array = PolarArray(Geometry=move.Geometry, Plane=PlaneXY(0, 0, 0), Count=Slider(5, range=0..10), Angle=6.283185307)  # -> Geometry, Transform
number_2 = Number(0.85)
number_3 = Number(5)
cardboard_thickness = Slider(0.125, range=0..0.25)
number_4 = Number(36)
polygon = Polygon(Plane=PlaneXY(0, 0, 0), Radius=number_2, Segments=number_3, FilletRadius=0)  # -> Polygon, Length
rotate = Rotate(Geometry=polar_array.Geometry, Angle=degrees(number_4), Plane=PlaneXY(0, 0, 0))  # -> Geometry, Transform
# Subtract 0.020 in from the cardboard thickness for a press it for the slots.
rotate_2 = Rotate(Geometry=polygon.Polygon, Angle=degrees(18), Plane=PlaneXY(0, 0, 0))  # -> Geometry, Transform
subtraction_2 = Subtraction(A=cardboard_thickness, B=0.2)
# 1st trim: Creates flower shape
trim_with_regions = TrimWithRegions(Curve=rotate.Geometry, Regions=rotate_2.Geometry)  # -> flatten(Inside), Outside
trim_with_regions_2 = TrimWithRegions(Curve=rotate_2.Geometry, Regions=rotate.Geometry)  # -> Inside, flatten(Outside)
number_5 = Number(0.4)
division = Division(A=subtraction_2, B=-2)
join_curves = JoinCurves(Curves=[trim_with_regions_2.Outside, trim_with_regions.Outside], Preserve=False)
number_6 = Number(0.46)
rectangle = Rectangle(Plane=PlaneXY(0, 0, 0), XSize=subtraction_2, YSize=number_5, Radius=0)  # -> Rectangle, Length
vector_xyz_2 = VectorXYZ(XComponent=division, YComponent=number_6, ZComponent=0)  # -> Vector, Length
join_curves_2 = JoinCurves(Curves=flatten(join_curves), Preserve=False)
move_2 = Move(Geometry=rectangle.Rectangle, Motion=vector_xyz_2.Vector)  # -> Geometry, Transform
polar_array_2 = PolarArray(Geometry=move_2.Geometry, Plane=PlaneXY(0, 0, 0), Count=5, Angle=6.283185307)  # -> Geometry, Transform
trim_with_regions_3 = TrimWithRegions(Curve=join_curves, Regions=polar_array_2.Geometry)  # -> flatten(Inside), flatten(Outside)
# 2nd trim: Slots
trim_with_regions_4 = TrimWithRegions(Curve=polar_array_2.Geometry, Regions=join_curves_2)  # -> flatten(Inside), Outside
join_curves_3 = JoinCurves(Curves=[trim_with_regions_4.Inside, trim_with_regions_3.Outside], Preserve=False)  # -> flatten(Curves)
construct_point = ConstructPoint(XCoordinate=0, YCoordinate=0, ZCoordinate=cardboard_thickness)
vector_2pt = Vector2Pt(PointA=Point(0, 0, 0), PointB=construct_point, Unitize=False)  # -> Vector, Length
brep = Brep(join_curves_3)
# Extrude by cardboard thickness
extrude = Extrude(Base=brep, Direction=vector_2pt.Vector)
